# Grasshopper definition DataGeneration.gh (Grasshopper 0.9.76)
# plug-ins: Owl.GH

range = Range(Domain=Domain(0, 1), Steps=Slider(100, range=0..1000))
crossref = CrossReference(ListA=range, ListB=range, CrossMode=1)  # -> ListA, ListB
pop3d = Populate3D(Region={Plane=PlaneXY(0, 0, 0), X=Domain(0, 1), Y=Domain(0, 1), Z=Domain(0, 1)}, Count=Slider(100, range=0..100), Seed=1)
pt = ConstructPoint(XCoordinate=crossref.ListA, YCoordinate=crossref.ListB, ZCoordinate=0)
pdecon = Deconstruct(Point=pop3d)  # -> XComponent, YComponent, ZComponent
pdecon_2 = Deconstruct(Point=pt)  # -> XComponent, YComponent, ZComponent
featurets = FeatureTensorSet(Feature0=pdecon_2.XComponent, Feature1=pdecon_2.YComponent)
featurets_2 = FeatureTensorSet(Feature0=pdecon.ZComponent)
featurets_3 = FeatureTensorSet(Feature0=pdecon.XComponent, Feature1=pdecon.YComponent)
toidx = SaveIDXTensorSet(TensorSet=featurets_2, SaveFile="C:/Users/Mateusz/Desktop/Random100_Outputs.idx", DataType="System.Single")
toidx_2 = SaveIDXTensorSet(TensorSet=featurets_3, SaveFile="C:/Users/Mateusz/Desktop/Random100_Inputs.idx", DataType="System.Single")
toidx_3 = SaveIDXTensorSet(TensorSet=featurets, SaveFile="C:/Users/Mateusz/Desktop/Random100_Query.idx", DataType="System.Single")
